# Grasshopper definition test.gh (Grasshopper 0.9.76)
# plug-ins: MeshEdit Components, Circulation

pt = Point(Point(11, 47, 0))
pt_2 = Point(Point(4.484005723, 1.437050503, 0))
geo = Geometry(<curve referenced from the Rhino model>)
geo_2 = Geometry([<curve referenced from the Rhino model> x4])
agent = Agent(Name="agent1", Origin="start", Destination="end", Count=Slider(100, range=0..1000))  # -> flatten(Agent)
node = Node(Position=pt_2, Name="start", Floor="floor1")
node_2 = Node(Position=pt, Name="end", Floor="floor1")
barrier = Barrier(Boundary=geo_2, Floor="floor1")
floor = Floor(Boundary=geo, Name="floor1")
number_slider = Slider(1, range=0..10)
env = Environment(Entities=[floor, barrier, node, node_2, agent], Resolution=number_slider, Run=Toggle(True))

dmap = DensityMap(Environment=env, FloorName="floor1", NonZero=Toggle(False))  # -> Mesh, Values
gradient = Gradient(
    LowerLimit="1",
    UpperLimit="0",
    Parameter=dmap.Values,
    stops=[0: RGB(255, 0, 255), 0.25: RGB(234, 126, 0), 0.5: RGB(254, 244, 84), 0.75: RGB(173, 203, 249), 1: RGB(75, 107, 169)])
explode = MeshExplode(Mesh=dmap.Mesh, Interpolate=False)
preview = CustomPreview(Geometry=explode, Shader=gradient)

bmap = BarrierMap(Environment=env, FloorName="floor1")  # -> Mesh, Values
gradient_2 = Gradient(LowerLimit=0, UpperLimit=1, Parameter=bmap.Values, stops=[0: RGB(0, 128, 0), 0.5: RGB(255, 255, 0), 1: RGB(255, 0, 0)])
explode_2 = MeshExplode(Mesh=bmap.Mesh, Interpolate=False)
preview_2 = CustomPreview(Geometry=explode_2, Shader=gradient_2)

omap = OccupancyMap(Environment=env, FloorName="floor1", Generation=Slider(19, range=0..100))  # -> Mesh, Values
sqr = Square(Value=number_slider)
bnd = Bounds(Numbers=omap.Values)
gradient_3 = Gradient(
    LowerLimit=sqr,
    UpperLimit="0",
    Parameter=omap.Values,
    stops=[0: RGB(255, 0, 255), 0.25: RGB(234, 126, 0), 0.5: RGB(254, 244, 84), 0.75: RGB(173, 203, 249), 1: RGB(75, 107, 169)])
panel = Panel(sqr)
panel_2 = Panel(bnd)
explode_3 = MeshExplode(Mesh=omap.Mesh, Interpolate=False)
preview_3 = CustomPreview(Geometry=explode_3, Shader=gradient_3)

apaths = AgentPaths(Environment=env, AgentName="agent1")  # -> Mesh, Indexes, Log
